vi "Add_alloy.gvi"   [G Web Development Software 22.3.0]
inputs:
  "String Array Input": string[]
  "Alloy": string
outputs:
  "String Array Output": string[]
diagram:
  Is Empty String Or Path(string/path=$Alloy) -> w1
  case (w1) {
    frame True {
      w2 = $"String Array Input"
    }
    frame False {
      Search 1D Array(1D array=$"String Array Input", element=$Alloy) -> (index of element=w3)
      Is Greater Or Equal To 0(x=w3) -> w4
      case (w4) {
        frame False, Default {
          Insert Into Array(inArray=$"String Array Input", new=$Alloy) -> w2
        }
        frame True {
          Delete From Array(inArray=$"String Array Input", index0=w3) -> w2
        }
      }
    }
  }
  $"String Array Output" <- w2
