vi "Add_feature.gvi"   [G Web Development Software 22.3.0]
inputs:
  "Features_list_in": cluster{"Feature_name": string, "Value": string}[]
  "Feature": string
  "Value": string
outputs:
  "Features_list_out": cluster{"Feature_name": string, "Value": string}[]
diagram:
  Array Size(array=$Features_list_in) -> (size(s)=w1)
  Is Less(x=w1, y=3) -> w2
  case (w2) {
    frame False, Default {
      One Button Dialog(message="Нельзя добавить больше 3 (трех) свойств!")
      w3 = $Features_list_in
    }
    frame True {
      for {
        w4 = each element of $Features_list_in
        Property Node(instance in=w4) -> ("Feature_name"=w6, instance out=w7)
        Is Equal(x=w6, y=$Feature) -> w8
        case (w8) {
          frame False, Default {
            w9 = w7
          }
          frame True {
            Property Node(instance in=w7, "Value"=$Value) -> (instance out=w9)
          }
        }
        append w9 to w5
        stop if w8
      }
      case (w8) {
        frame True {
          w3 = w5
        }
        frame False {
          Property Node(instance in=w9, "Feature_name"=$Feature, "Value"=$Value) -> (instance out=w10)
          Insert Into Array(inArray=w5, new=w10) -> w3
        }
      }
    }
  }
  $Features_list_out <- w3
