vi "Alloys sort.gvi"   [G Web Development Software 22.3.0]
inputs:
  "Alloys_list_arr": T1[]
  "Part_material_ref": "ComboBoxSelector reference"
  "Error In": error
outputs:
  "Error Out": error
types:
  T1 = cluster{"Alloys": string[], "Alloy_type": string}
diagram:
  for {
    w1 = each element of $Alloys_list_arr
    Property Node(instance in=w1) -> ("Alloy_type"=w3)
    append w3 to w2
  }
  Array Index(array=w2) -> (out0[_]=w4)
  Property Node(instance in=$Part_material_ref, "Items"=w2, "ValueSignaling"=w4, error in=$"Error In") -> (error out=w5, instance out=w6)
  Close Reference(error in=w5, reference=w6) -> (error out=w7)
  $"Error Out" <- w7
