vi "Del_feature.gvi"   [G Web Development Software 22.3.0]
inputs:
  "Feature_list_in": cluster{"Feature_name": string, "Value": string}[]
  "Feature": string
outputs:
  "Feature_list_out": cluster{"Feature_name": string, "Value": string}[]
diagram:
  for (iteration -> i1) {
    w1 = each element of $Feature_list_in
    Property Node(instance in=w1) -> ("Feature_name"=w2)
    Is Equal(x=w2, y=$Feature) -> w3
    stop if w3
  }
  case (w3) {
    frame False, Default {
      w4 = $Feature_list_in
    }
    frame True {
      Delete From Array(inArray=$Feature_list_in, index0=i1) -> w4
    }
  }
  $Feature_list_out <- w4
