vi "Patr_info_to_str.gvi"   [G Web Development Software 22.3.0]
inputs:
  "Parts_info": "Part_info.gtype"
outputs:
  "Part_info_str": string
  "Ready_to_analyze": bool
types:
  T1 = cluster{"Part_type": string, "Part_size": string, "Alloys": string[], "Features_list": cluster{"Feature_name": string, "Value": string}[]}
  T2 = cluster{"Alloys": string[], "Alloy_type": string}
  "Part_info.gtype" = cluster{"Parts_info": T1, "Alloys_group_arr": T2[]}
uses:
  NI::G Core::Strings::Search and Replace Pattern.gvi
diagram:
  Property Node(instance in=$Parts_info) -> ("Parts_info:Part_type"=w1, "Parts_info:Part_size"=w2, "Parts_info:Alloys"=w3, "Parts_info:Features_list"=w4)
  Is Empty String Or Path(string/path=w1) -> w5
  case (w5) {
    frame True {
      # Поле "тип детали" пусто
      w6 = ""
    }
    frame False {
      for {
        w7 = each element of w4
        Property Node(instance in=w7) -> ("Feature_name"=w9, "Value"=w10)
        Concatenate Strings("-", w9, ": ", w10, "\r\n") -> w11
        append w11 to w8
      }
      Concatenate Strings(w8) -> w12
      w13 = "Деталь: {part_type}\nПлощадь поверхности: \n{pat_size}\nМатериал детали: {alloys}\nТребуемые свойства\n"
      call "Search and Replace Pattern.gvi"(string=w13, pattern="{part_type}", replace string=w1) -> (result string=w14)
      call "Search and Replace Pattern.gvi"(string=w14, pattern="{pat_size}", replace string=w2) -> (result string=w15)
      Array Size(array=w3) -> (size(s)=w16)
      Decrement(x=w16) -> w17
      for (iteration -> i1) {
        w18 = each element of w3
        Is Equal(x=w17, y=i1) -> w20
        case (w20) {
          frame False, Default {
            Concatenate Strings(w18, ", ") -> w21
          }
          frame True {
            w21 = w18
          }
        }
        append w21 to w19
      }
      Concatenate Strings(w19) -> w22
      call "Search and Replace Pattern.gvi"(string=w15, pattern="{alloys}", replace string=w22) -> (result string=w23)
      Concatenate Strings(w23, w12) -> w6
    }
  }
  $Part_info_str <- w6
  Is Empty Array(array=w3) -> w24
  Is Empty Array(array=w4) -> w25
  Logical Or[output inverted](w5, w24, w25) -> w26
  $Ready_to_analyze <- w26
