vi "Select_meth.gvi"   [G Web Development Software 22.3.0]
inputs:
  "Size": string
  "Material": string
outputs:
  "Tab": enum{"Idle", "MDO", "CXTO", "No_data"}
diagram:
  s1 = "Idle"  # shift register
  while {
    case (s1) {
      frame "Idle", Default {
        w1 = "MDO"
        w2 = FALSE
      }
      frame "MDO" {
        w3 = ["Алюминий деформируемый", "Алюминий литейный", "Титан деформируемый", "Титан литейный", "Магний деформируемый", "Магний литейный"]
        for {
          w4 = each element of w3
          Is Equal(x=w4, y=$Material) -> w6
          append w6 to w5
        }
        Or Array Elements(Boolean array=w5) -> (logical OR=w2)
        Select(s=w2, t="MDO", f="CXTO") -> w1
      }
      frame "CXTO" {
        for {
          w7 = each element of ["Конструкционная сталь", "Инструментальная сталь"]
          Is Equal(x=w7, y=$Material) -> w9
          append w9 to w8
        }
        Or Array Elements(Boolean array=w8) -> (logical OR=w10)
        for {
          w11 = each element of ["0,01-0,05 дм2", "0,05-0,1 дм2"]
          Is Equal(x=w11, y=$Size) -> w13
          append w13 to w12
        }
        Or Array Elements(Boolean array=w12) -> (logical OR=w14)
        Logical And(w14, w10) -> w2
        Select(s=w2, t="CXTO", f="No_data") -> w1
      }
      frame "No_data" {
        w1 = "No_data"
        w2 = TRUE
      }
    }
    next s1 = w1
    stop if w2
  }
  $Tab <- s1
