vi "index.gviweb"   [G Web Development Software 22.3.0]
panel controls:
  "Part_shape": string
  "Part_size": string = "0,01-0,05 дм2"
  "Alloys_list": i32[]
  "Select_part": bool
  "Start_analysis": bool
  "Part_material": string
  "Part_info": "Part_info.gtype" = {"Parts_info"={"Part_type"="", "Part_size"="", "Alloys"=[], "Features_list"=[]}, "Alloys_group_arr"=[{"Alloys"=["сплав1", "сплав2"], "Alloy_type"="Девормируемые сплавы"}, {"Alloys"=["мат1", "мат2"], "Alloy_type"="Литейные сплавы"}]}
  "Part_property": string = "Износостойкость"
  "Property_value": string
  "Select_property": bool
  "Delet_property": bool
panel indicators:
  "Tab": i32
  "Cluster": cluster{"URL Image": string}
  "Part_info_str": string
  "logo_Image": string
  "Mao_process_recomendation": string
  "Cxto_process_recomendation": string
types:
  T1 = cluster{"Part_type": string, "Part_size": string, "Alloys": string[], "Features_list": cluster{"Feature_name": string, "Value": string}[]}
  T2 = cluster{"Alloys": string[], "Alloy_type": string}
  "Part_info.gtype" = cluster{"Parts_info": T1, "Alloys_group_arr": T2[]}
uses:
  WebApp::Patr_info_to_str.gvi
  WebApp::Add_feature.gvi
  WebApp::Del_feature.gvi
  WebApp::Select_meth.gvi
  NI::HTTP::GET.gvi
  WebApp::Alloys sort.gvi
diagram:
  s1 = ["init"]  # shift register
  s2 = $Part_info  # shift register
  s3 = no error  # shift register
  while {
    Delete From Array(inArray=s1, index0=0) -> (outArray=w1, deleted=w2)
    case (w2) {
      frame "Wait_for_event", Default {
        event (timeout = 100) {
          on "Timeout" {
            call "Patr_info_to_str.gvi"(Parts_info=s2) -> (Part_info_str=w6, Ready_to_analyze=w7)
            $Part_info_str <- w6
            Is Empty String Or Path(string/path=w6) -> w8
            Property Node(instance in=reference to "Alloys_list", "Disabled"=w8)
            Property Node(instance in=reference to "Part_material", "Disabled"=w8)
            Not(x=w7) -> w9
            Select(s=w7, t=4282038392, f=4294967295) -> w10
            Property Node(instance in=reference to "Start_analysis", "FalseColor"=w10, "Disabled"=w9) -> (error out=w11, instance out=w12)
            Close Reference(error in=w11, reference=w12)
            w3 = w1
            w4 = s3
            w5 = s2
          }
          on "Part_shape" Value changed {
            w13 = "load_part_image"  # main_states
            Build Array(w1, w13) -> w3
            w4 = s3
            w5 = s2
          }
          on "Select_part" Value changed {
            Property Node(instance in=reference to "Part_shape") -> ("ItemsAndValues"=w14, "Value"=w15, error out=w16, instance out=w17)
            for {
              w18 = each element of w14
              Property Node(instance in=w18) -> ("String"=w19, "Value"=w20)
              Is Equal(x=w20, y=w15) -> w21
              stop if w21
            }
            Property Node(instance in=s2, "Parts_info:Part_type"=w19, "Parts_info:Part_size"=$Part_size) -> (instance out=w5)
            Close Reference(error in=w16, reference=w17)
            w3 = w1
            w4 = s3
          }
          on "Part_material" Value changed {
            Property Node(instance in=s2) -> ("Alloys_group_arr"=w22, instance out=w5)
            w23 = $Part_material
            for {
              w24 = each element of w22
              Property Node(instance in=w24) -> ("Alloys"=w25, "Alloy_type"=w26)
              Is Equal(x=w26, y=w23) -> w27
              stop if w27
            }
            Property Node(instance in=reference to "Alloys_list", "Items"=w25) -> (error out=w28, instance out=w29)
            Close Reference(error in=w28, reference=w29)
            w3 = w1
            w4 = s3
          }
          on "Alloys_list" Value changed {
            Property Node(instance in=reference to "Alloys_list") -> ("Items"=w30, error out=w31, instance out=w32)
            for {
              w33 = each element of $Alloys_list
              Array Index(array=w30) -> (out0[w33]=w35)
              append w35 to w34
            }
            Property Node(instance in=s2, "Parts_info:Alloys"=w34) -> (instance out=w5)
            Close Reference(error in=w31, reference=w32)
            w3 = w1
            w4 = s3
          }
          on "Part_property" Value changed {
            Event Data() -> ("New Value"=w36)
            case (w36) {
              frame Default {
                w37 = reference to "Property_value"
                w38 = no error
                w39 = string[] []
              }
              frame "Износостойкость" {
                Property Node(instance in=reference to "Property_value", "Items"=["Нормальная", "Высокая", "Очень высокая"], "Visible"=TRUE) -> (error out=w38, instance out=w37)
                w39 = ["Нормальная", "Высокая", "Очень высокая"]
              }
              frame "Коррозионная стойкость" {
                Property Node(instance in=reference to "Property_value", "Items"=["Нормальная", "Высокая", "Очень высокая"], "Visible"=TRUE) -> (error out=w38, instance out=w37)
                w39 = ["Нормальная", "Высокая", "Очень высокая"]
              }
              frame "Теплостойкость" {
                Property Node(instance in=reference to "Property_value", "Items"=["Нормальная", "Высокая", "Очень высокая"], "Visible"=TRUE) -> (error out=w38, instance out=w37)
                w39 = ["Нормальная", "Высокая", "Очень высокая"]
              }
              frame "Жаростойкость" {
                Property Node(instance in=reference to "Property_value", "Items"=["Нормальная", "Высокая", "Очень высокая"], "Visible"=TRUE) -> (error out=w38, instance out=w37)
                w39 = ["Нормальная", "Высокая", "Очень высокая"]
              }
              frame "Электроизоляционные свойства" {
                Property Node(instance in=reference to "Property_value", "Items"=["От 1 до 100 В", "От 100 до 500 В", "От 500 до 1000 В"], "Visible"=TRUE) -> (error out=w38, instance out=w37)
                w39 = ["От 1 до 100 В", "От 100 до 500 В", "От 500 до 1000 В"]
              }
              frame "Адгезионный подслой" {
                Property Node(instance in=reference to "Property_value", "Items"=string[] [], "Visible"=FALSE) -> (error out=w38, instance out=w37)
                w39 = string[] []
              }
              frame "Конструкционная жесткость" {
                Property Node(instance in=reference to "Property_value", "Items"=string[] [], "Visible"=FALSE) -> (error out=w38, instance out=w37)
                w39 = string[] []
              }
            }
            Array Index(array=w39) -> (out0[_]=w40)
            Property Node(instance in=w37, "Value"=w40, error in=w38) -> (error out=w41, instance out=w42)
            Close Reference(error in=w41, reference=w42)
            w3 = w1
            w4 = s3
            w5 = s2
          }
          on "Select_property" Value changed {
            Property Node(instance in=s2) -> ("Parts_info:Features_list"=w43, instance out=w44)
            call "Add_feature.gvi"(Features_list_in=w43, Feature=$Part_property, Value=$Property_value) -> (Features_list_out=w45)
            Property Node(instance in=w44, "Parts_info:Features_list"=w45) -> (instance out=w5)
            w3 = w1
            w4 = s3
          }
          on "Delet_property" Value changed {
            Property Node(instance in=s2) -> ("Parts_info:Features_list"=w46, instance out=w47)
            call "Del_feature.gvi"(Feature_list_in=w46, Feature=$Part_property) -> (Feature_list_out=w48)
            Property Node(instance in=w47, "Parts_info:Features_list"=w48) -> (instance out=w5)
            w3 = w1
            w4 = s3
          }
          on "Start_analysis" Value changed {
            Property Node(instance in=s2) -> ("Parts_info:Part_size"=w49, instance out=w5)
            call "Select_meth.gvi"(Size=w49, Material=$Part_material) -> (Tab=w50)
            $Tab <- w50
            case (w50) {
              frame "Idle", Default {
                w3 = w1
              }
              frame "MDO" {
                Build Array(w1, ["mao_recom_request"]) -> w3
              }
              frame "CXTO" {
                Build Array(w1, ["cxto_recom_request"]) -> w3
              }
              frame "No_data" {
                w3 = w1
              }
            }
            w4 = s3
          }
        }
      }
      frame "init" {
        $Tab <- 0
        Property Node(instance in=reference to "Part_property", "ValueSignaling"=$Part_property) -> (error out=w51, instance out=w52)
        Close Reference(error in=w51, reference=w52)
        Reinitialize To Default(reference in=reference to "Alloys_list") -> (reference out=w53, error out=w54)
        Close Reference(error in=w54, reference=w53)
        Build Array(w1, ["get_parts_list", "get_alloys_list"]) -> w3
        $logo_Image <- "Graphics/stankin_logo_ru.svg"
        w4 = s3
        w5 = s2
      }
      frame "load_part_image" {
        Concatenate Strings("Get_part_image?Part_name=", $Part_shape) -> w55
        Concatenate Strings("http://109.205.212.79:80/WebUIService/", w55) -> w56
        Build Cluster(w56) -> w57
        $Cluster <- w57
        w3 = w1
        w4 = s3
        w5 = s2
      }
      frame "stop" {
        w3 = w1
        w4 = s3
        w5 = s2
      }
      frame "get_parts_list" {
        Concatenate Strings("http://109.205.212.79:80/WebUIService/", "Get_parts_list") -> w58
        call "GET.gvi"(url=w58) -> (body=w59, error out=w60)
        Unflatten From Json(JSON string=w59, error in (no error)=w60, path=["Parts_list"], type and defaults=cluster{"String": string, "Value": string}[] []) -> (error out=w61, value=w62)
        Array Index(array=w62) -> (out0[_]=w63)
        Property Node(instance in=w63) -> ("Value"=w64)
        Property Node(instance in=reference to "Part_shape", "ItemsAndValues"=w62, "ValueSignaling"=w64, error in=w61) -> (error out=w65, instance out=w66)
        Close Reference(error in=w65, reference=w66) -> (error out=w4)
        w3 = w1
        w5 = s2
      }
      frame "get_alloys_list" {
        Property Node(instance in=s2) -> ("Alloys_group_arr"=w67, instance out=w68)
        Concatenate Strings("http://109.205.212.79:80/WebUIService/", "Get_alloys_list") -> w69
        call "GET.gvi"(url=w69) -> (body=w70, error out=w71)
        Unflatten From Json(JSON string=w70, error in (no error)=w71, path=["Alloys_group_arr"], type and defaults=w67) -> (error out=w72, value=w73)
        Property Node(instance in=w68, "Alloys_group_arr"=w73) -> (instance out=w5)
        call "Alloys sort.gvi"(Part_material_ref=reference to "Part_material", Alloys_list_arr=w73, Error In=w72) -> (Error Out=w4)
        w3 = w1
      }
      frame "mao_recom_request" {
        Property Node(instance in=s2) -> ("Parts_info"=w74, instance out=w5)
        Flatten To Json(anything=w74) -> (JSON string=w75, error out=w76)
        Concatenate Strings("Get_recomendation?Part_param_json=", w75) -> w77
        Concatenate Strings("http://109.205.212.79:80/WebUIService/", w77) -> w78
        call "GET.gvi"(timeout=2000, url=w78, error in=w76) -> (body=w79, error out=w80)
        Unflatten From Json(JSON string=w79, error in (no error)=w80, path=["Recommendation"], type and defaults=string "Ошибка") -> (error out=w4, value=w81)
        $Mao_process_recomendation <- w81
        w3 = w1
      }
      frame "cxto_recom_request" {
        w82 = """Тип электролита:
Суспензия

Концентрация основных компонентов электролита:

Режим обработки:
Анодный		Анодно-катодный		Комбинированный

Время обработки:
15-30 мин	30-60 мин	60-120 мин	120-240 мин

Дополнительные операции:"""
        $Cxto_process_recomendation <- w82
        w3 = w1
        w4 = s3
        w5 = s2
      }
    }
    next s1 = w3
    next s2 = w5
    next s3 = w4
    stop if FALSE
  }
